# Grasshopper definition PartitionVector.gh (Grasshopper 1.0.8)
# plug-ins: GHOpenCL, GHParallelFlow

int = Integer(Slider(4, range=0..10))
int_2 = Integer(Slider(100, range=0..100))
int_3 = Integer(Slider(6, range=0..10))
int_4 = Integer(Slider(2, range=0..10))
S = Series(S=Slider(0, range=0..100), N=Slider(1, range=0..1), C=int_2)  # -> Kernel, R
S_2 = Series(S=int_4, N=int, C=int_3)  # -> Kernel, R
vectortolist = VectorToList(Vector=S_2.R)
part = PartitionList(V=S.R, S=S_2.R)  # -> Kernel, P
panel = Panel(vectortolist)
vectortolist_2 = VectorToList(Vector=part.P)
computer = Computer(Kernel=part.Kernel)
panel_2 = Panel(vectortolist_2)
