# Grasshopper definition crossRef.gh (Grasshopper 1.0.8)
# plug-ins: GHOpenCL, GHParallelFlow

dom = ConstructDomain(DomainStart=0, DomainEnd=1)
int = Integer(Slider(30, range=0..100))
int_2 = Integer(Slider(20, range=0..100))
range = Range(Domain=dom, Steps=int_2)  # -> Kernel, R
S = Series(S=Slider(0, range=0..1), N=Slider(10, range=0..10), C=int)  # -> Kernel, R
vectortolist = VectorToList(Vector=S.R)
vectortolist_2 = VectorToList(Vector=range.R)
addition = Addition(A=range.R, B=S.R)  # -> Kernel, R
crossref = CrossReference(ListA=vectortolist_2, ListB=vectortolist, CrossMode=1)  # -> ListA, ListB
addition_2 = Addition(A=crossref.ListA, B=crossref.ListB)
vectortolist_3 = VectorToList(Vector=addition.R)
computer = Computer(Kernel=addition.Kernel)
subtraction = Subtraction(A=vectortolist_3, B=addition_2)
panel = Panel(subtraction)
