# Grasshopper definition randomValue.gh (Grasshopper 1.0.8)
# plug-ins: GHOpenCL, GHParallelFlow

number_slider = Slider(-45.3, range=-100..101)
number_slider_2 = Slider(100, range=-100..101)
int = Integer(Slider(200000, range=0..1000000))
int_2 = Integer(Slider(9, range=0..100))

dom = ConstructDomain(DomainStart=number_slider, DomainEnd=number_slider_2)
# CPU
random = Random(Range=dom, Number=int, Seed=int_2)

# ----
# GPU
ran = Random(Min=number_slider, Max=number_slider_2, Count=int, Seed=int_2)  # -> Kernel, R
computer = Computer(Kernel=ran.Kernel)

vectortolist = VectorToList(Vector=ran.R)
panel = Panel(vectortolist)
